# Grasshopper definition capture.gh (Grasshopper 1.0.7)
# plug-ins: LadybugGrasshopper

prompt = Panel("""White interior view, 
Large window of side wall with trees, 
Brown sofa, 
Multiple steel stools, 
Wood table, 
White rug, 
Steel bookshelf""")
ghpython_script = GhPythonScript()  # -> out, a; disabled
# ---------- ghpython_script: Python ----------
import os
import sys
import subprocess
import scriptcontext as sc

def run_bat_file():
    
    
    dir_path = os.path.join(
        "\\".join(sc.doc.Path.split("\\")[:-1]),
    )
    
    if dir_path not in sys.path:
        sys.path.append(dir_path)
    
    cmd_dir_change = "cd {d}".format(d=dir_path)
    cmd_webui_bat = "webui-user.bat"
    
    print(dir_path + "\\" + cmd_webui_bat)
    
    try:
        subprocess.call([dir_path + "\\" + cmd_webui_bat])
    except subprocess.CalledProcessError as e:
        print("Error executing batch file:", e)

if __name__ == "__main__":
    run_bat_file()
# ---------- end ghpython_script ----------
ghpython_script_2 = GhPythonScript(prompt=prompt)  # -> out, draft, rendered
# ---------- ghpython_script_2: Python ----------
import os
import json
import Rhino
import base64
import urllib2
import scriptcontext as sc
import System.Drawing.Imaging as Imaging


class D2R:
    """Convert Draft to Rendered using `stable diffusion webui` API"""
    
    def __init__(
        self, prompt, width, height, local_url="http://127.0.0.1:7860"
    ):
        self.prompt = prompt
        self.width = width
        self.height = height
        self.local_url = local_url
        
        
        (   # Unpack model names string
            self.model_ip2p,
            self.model_shuffle,
            self.model_tile,
            self.model_depth,
            self.model_canny,
            self.model_inpaint,
            self.model_lineart,
            self.model_mlsd,
            self.model_normalbae,
            self.model_openpose,
            self.model_scribble,
            self.model_seg,
            self.model_softedge,
        ) = self._get_model_list(local_url)
        
        
        (   # Unpack module names string
            self.module_none,
            self.module_canny,
            self.module_depth,
            self.module_depth_leres,
            self.module_depth_leres_pp,
            self.module_hed,
            self.module_hed_safe,
            self.module_mediapipe_face,
            self.module_mlsd,
            self.module_normal_map,
            self.module_openpose,
            self.module_openpose_hand,
            self.module_openpose_face,
            self.module_openpose_faceonly,
            self.module_openpose_full,
            self.module_clip_vision,
            self.module_color,
            self.module_pidinet,
            self.module_pidinet_safe,
            self.module_pidinet_sketch,
            self.module_pidinet_scribble,
            self.module_scribble_xdog,
            self.module_scribble_hed,
            self.module_segmentation,
            self.module_threshold,
            self.module_depth_zoe,
            self.module_normal_bae,
            self.module_oneformer_coco,
            self.module_oneformer_ade20k,
            self.module_lineart,
            self.module_lineart_coarse,
            self.module_lineart_anime,
            self.module_lineart_standard,
            self.module_shuffle,
            self.module_tile_resample,
            self.module_invert,
            self.module_lineart_anime_denoise,
            self.module_reference_only,
            self.module_reference_adain,
            self.module_reference_adain_attn,
            self.module_inpaint,
            self.module_inpaint_only,
            self.module_inpaint_only_lama,
            self.module_tile_colorfix,
            self.module_tile_colorfix_sharp
        ) = self._get_module_list(local_url)
        
    def _get_model_list(self, local_url):
        request = urllib2.Request(
            "{url}/controlnet/model_list".format(url=local_url)
        )
        
        response = urllib2.urlopen(request)
        
        # Get model names string
        return json.loads(response.read())["model_list"]
    
    def _get_module_list(self, local_url):
        request = urllib2.Request(
            "{url}/controlnet/module_list".format(url=local_url)
        )
        
        response = urllib2.urlopen(request)
        
        # Get model names string
        return json.loads(response.read())["module_list"]
        
    def _get_decoded_image_to_base64(self, image_path):
        with open(image_path, 'rb') as image_file:
            image_data = image_file.read()
            base64_data = base64.b64encode(image_data)
            decoded_image = base64_data.decode('utf-8')
            return decoded_image
        
    def capture_activated_viewport(self, save_name="temp.png"):
        """
            Capture and save the currently activated viewport 
            to the location of the current *.gh file path.
        """
        
        current_file_path = sc.doc.Path
        save_dir = "\\".join(sc.doc.Path.split("\\")[:-1])
        save_path = os.path.join(save_dir, save_name)
        
        viewport = Rhino.RhinoDoc.ActiveDoc.Views.ActiveView.CaptureToBitmap()
        viewport.Save(save_path, Imaging.ImageFormat.Png)
        Rhino.RhinoDoc.ActiveDoc.Views.ActiveView.CaptureToBitmap()
        
        return save_path
    
    def render(self, image_path):
        payload = {
            "prompt": self.prompt,
            "negative_prompt": "",
            "resize_mode": 0,
            "denoising_strength": 0.75,
            "mask_blur": 36,
            "inpainting_fill": 0,
            "inpaint_full_res": "true",
            "inpaint_full_res_padding": 72,
            "inpainting_mask_invert": 0,
            "initial_noise_multiplier": 1,
            "seed": -1,
            "sampler_name": "Euler a",
            "batch_size": 1,
            "steps": 20,
            "cfg_scale": 7,
            "width": self.width,
            "height": self.height,
            "restore_faces": "false",
            "tiling": "false",
            "alwayson_scripts": {
                "ControlNet": {
                "args": [
                    {
                        "enabled": "true",
                        "input_image": self._get_decoded_image_to_base64(image_path),
                        "module": self.module_pidinet_scribble,
                        "model": self.model_scribble,
                    },
                ]
                }
            }
        }
        
        request = urllib2.Request(
            "{url}/sdapi/v1/txt2img".format(url=self.local_url),
            data=payload
        )
        
        response = urllib2.urlopen(request)


if __name__ == "__main__":
    d2r = D2R(prompt=prompt, width=1000, height=500)
    draft = d2r.capture_activated_viewport(save_name="viewport.png")
    
    d2r.render(draft)
# ---------- end ghpython_script_2 ----------
lb_imageviewer = LBImageViewer(ImagePath_=ghpython_script_2.draft, _scale_=1, DisableClickable=False, SaveImgWithCoords=False, scale=1)  # -> ImagePath, Values, GIF
